# Grasshopper definition all components example.gh (Grasshopper 1.0.7)
# plug-ins: ParametricCamp2023SVV, HAL for Grasshopper

sessionsettings = SessionSettings()  # -> Data, DefaultSettings

# ---- group: INPUT: Import text file
# INFO: Here, I've shown two different aproaches to get the vectors for drawing section curves to illustrate how there are several ways to reach the same target. One aproach assumes that the necessary information is recieved from a text file, while the other use some internalised curves from Rhino.
file_path = FilePath("C:\Users\sverremh\OneDrive - NTNU\Spring 2023\Parametric Camp SVV\section_coordinates.txt")
read_file = ReadFile(File=file_path, PerLineParse=True)

# ---- group: INPUT: Drawn section curves
curve = Curve(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)
curve_2 = Curve(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)
curve_3 = Curve(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)
curve_4 = Curve(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)

# ---- group: Find the three surfaces that represents the top deck.
# Here, I've baked and referenced the "Bridge plate"
number_slider = Slider(0.15, range=0.01..1)
brep = Brep(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)
deconstruct_brep = DeconstructBrep(Brep=brep)  # -> Faces, Edges, Vertices
area = Area(Geometry=deconstruct_brep.Faces)  # -> Area, Centroid
deconstruct = Deconstruct(Point=area.Centroid)  # -> XComponent, YComponent, ZComponent
sort_list = SortList(Keys=deconstruct.ZComponent, ValuesValuesA=deconstruct_brep.Faces)  # -> reverse(Keys), reverse(ValuesValuesA)
split_list = SplitList(List=sort_list.ValuesValuesA, Index="2")  # -> ListA, ListB
evaluate_surface = EvaluateSurface(Surface=reparameterize(deconstruct_brep.Faces), Point="0.5,0.5")  # -> Point, Normal, UDirection, VDirection, Frame
brep_2 = Brep(split_list.ListA)
unit_z = UnitZ(Factor=1)
angle = Angle(VectorA=evaluate_surface.Normal, VectorB=unit_z)  # -> Angle, Reflex
smaller_than = SmallerThan(FirstNumber=angle.Angle, SecondNumber=number_slider)  # -> SmallerThan, OrEqualTo
cull_pattern = CullPattern(List=deconstruct_brep.Faces, CullPattern=smaller_than.SmallerThan)
brep_3 = Brep(cull_pattern)

# ---- group: Create bridge plate from guide curves / INPUT: Guide curves
curve_5 = Curve(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)
curve_6 = Curve(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)
curve_7 = Curve(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)

# ---- group: Create some rebar shapes using a sine function. This could also be text input from a structural analysis. / Height of rebar
height_thick = Slider(2, range=0.2..2)
height_slender = Slider(1.4, range=0.2..2)
negative = Negative(Value=[height_slender, height_thick])

# ---- group: Periods
period_thick = Slider(6, range=2..6)
period_slender = Slider(3.2, range=2..6)
number = Number([period_slender, period_thick])

# ---- group: Create some rebar shapes using a sine function. This could also be text input from a structural analysis. / Amplitude
amplitude_thick = Slider(1.7, range=0.1..2.1)
amplitude_slender = Slider(0.7, range=0.1..0.7)
number_2 = Number([amplitude_slender, amplitude_thick])

# ---- group: Create some rebar shapes using a sine function. This could also be text input from a structural analysis.
steps = Slider(100, range=0..100)
range = Range(Domain=Domain(0, 1), Steps=steps)
expression = Expression(x=range, y=graft(number), a=graft(number_2), h=graft(negative), Expression="a * sin(x * 3*y) + h")
concatenate = Concatenate(Fragment_A=range, Fragment_B=",", A=expression)
quick_graph = QuickGraph(expression, SortOrder=0)

# ----
text = Text(concatenate)

# ---- group: Create Rebar
# INFO: I can use the same component to create different reinforcent types in different parts of the bridge deck thanks to DataTrees
slender_parts_of_deck = Panel("""-15
-2
0
2
11""")
thicker_parts = Panel("""-10
-8
6
9""")
entwine = Entwine(Branch00=slender_parts_of_deck, Branch01=thicker_parts, FlattenInputs=True)
brep_4 = Brep(brep_3)
bridgereinforcement = BridgeReinforcement(GuideCurve=reparameterize(curve_6), RebarPositions=text, RebarRadius="0.2", TopOfBridgeDeck=brep_4, RebarOffsets=entwine)

# ---- group: Modify text file and create section curves
c_script = CSharpScript(coords=read_file)  # -> out, pointCoords, names; inputs coords: list of String
# ---------- c_script: C# usings ----------
using System.Linq;
# ---------- c_script: C# ----------
    DataTree<string> sortedTree = new DataTree<string>(); // Empty tree to store the elements
    List<string> pointNames = new List<string>(); // the name of the section part the coordinates belong to

    int pathCount = 0;
    GH_Path path = new GH_Path(pathCount); // create the first path
    for (int i = 1; i < coords.Count; i++) // start the count on 1 as we do not want the header
    {
      string[] sub_els = coords[i].Split(',');
      var empty_strings = sub_els.Where(el => el.Length == 0).ToArray(); // find out if there are empty elements in the string
            
      if (empty_strings.Length > 0) // if there are any empty elements, this indicate the start of a new section part
      {
        pointNames.Add(sub_els[0]); // add the name to the list of names
        path = new GH_Path(pathCount);
        pathCount++; // increase the path count
      }
      else
      {
        // if items separated by ',' have values, we keep it as a coordinate
        sortedTree.Add(coords[i], path); 
      }
    }
    pointCoords = sortedTree;
    names = pointNames;
# ---------- end c_script ----------
xz_plane = XZPlane(Origin=Point(0, 0, 0))
text_split = TextSplit(Text=c_script.pointCoords, Separators=",")
list_item = ListItem(List=text_split, Index=0, Wrap=True)  # -> Item, Item1, Item2
vector_xyz = VectorXYZ(XComponent=list_item.Item, YComponent=list_item.Item1, ZComponent=list_item.Item2)  # -> Vector, Length
trim_tree = TrimTree(Tree=vector_xyz.Vector, Depth=1)
panel = Panel(c_script.names)
explode_tree = ExplodeTree(Data=trim_tree)  # -> Branch0, Branch1, Branch2, Branch3

# ---- group: Reference plane for cross section
plane = Plane(xz_plane)

# ----
explode = Explode(Curve=curve, Recursive=True)  # -> Segments, Vertices
explode_2 = Explode(Curve=curve_2, Recursive=True)  # -> Segments, Vertices
explode_3 = Explode(Curve=curve_4, Recursive=True)  # -> Segments, Vertices
explode_4 = Explode(Curve=curve_3, Recursive=True)  # -> Segments, Vertices
_1_crossseccurves = _1CrossSecCurves(
    CentreTopVecs=explode_2.Vertices,
    CentreBottomVecs=explode_3.Vertices,
    LeftVec=explode.Vertices,
    RightVec=explode_4.Vertices,
    PreviewPlane=plane)

# ---- group: Modify text file and create section curves (continued)
_1_crossseccurves_2 = _1CrossSecCurves(
    CentreTopVecs=explode_tree.Branch0,
    CentreBottomVecs=explode_tree.Branch1,
    LeftVec=explode_tree.Branch2,
    RightVec=explode_tree.Branch3,
    PreviewPlane=plane)

# ---- group: Create bridge plate from guide curves
plane_2 = Plane(plane)
_2_bridgeplatecurves = _2BridgePlateCurves(CenterCurve=curve_6, LeftCurve=curve_7, RightCurve=curve_5, Count=50, SectionCurves=_1_crossseccurves_2, Plane=plane_2)

# ---- group: PREVIEW
custom_preview = CustomPreview(Geometry=_2_bridgeplatecurves, Material=ColourSwatch(SwatchColor=RGBA(140, 140, 140, 139)))
custom_preview_2 = CustomPreview(Geometry=bridgereinforcement, Material=ColourSwatch(SwatchColor=RGB(122, 95, 51)))
