# Grasshopper definition brukasse fra linjer.gh (Grasshopper 1.0.7)
# plug-ins: RettTangent, HAL for Grasshopper

sessionsettings = SessionSettings()  # -> Data, DefaultSettings
horisontal_avstand_vertikal_avstand = Panel("""0.000, -0.080
0.000, -0.380
-3.000, -0.490
-3.292, -1.581""")
horisontal_avstand_vertikal_avstand_2 = Panel("""3.291, -1.581
2.999, -0.491
0.000, -0.380
0.000, -0.080""")
horisontal_avstand_vertikal_avstand_3 = Panel("""0.000, -0.080
1.226, -1.717
1.001, -0.610
-1.500, -0.475
-3.499, -0.535
-6.000, -0.760
-6.226, -1.867""")

# ---- group: Ledelinjer
curve = Curve(<curve referenced from the Rhino model>)

# ----
curve_2 = Curve(curve)
flip_curve = FlipCurve(Curve=curve_2)  # -> Curve, Flag

# ---- group: Kant venstre
curve_3 = Curve(<curve referenced from the Rhino model>)

# ---- group: Kant høyre
curve_4 = Curve(<curve referenced from the Rhino model>)

# ----
et_tang = ETTang(Tangent=[Vector(-0.6839411289, 0.7295372041, 0), Vector(-0.6319346216, 0.7750216991, 0), Vector(-0.5652566033, 0.8249151304, 0), Vector(-0.4819086776, 0.8762214483, 0), Vector(-0.3828583852, 0.9238070453, 0), Vector(-0.2739501951, 0.9617438799, 0)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])  # -> KryssProdukt, RettTangent
entwine = Entwine(Branch00=curve, Branch01=curve_3, Branch02=curve_4, FlattenInputs=True)

# ---- group: Hent ut forskyvninger vertikalt og horisontalt.
# Info: Bruker Tekst her i csv-format for å viser at dette eventuelt kan leses fra en tabell.
entwine_2 = Entwine(
    Branch00=horisontal_avstand_vertikal_avstand_3,
    Branch01=horisontal_avstand_vertikal_avstand_2,
    Branch02=horisontal_avstand_vertikal_avstand,
    FlattenInputs=True)
text = Text(entwine_2)
text_split = TextSplit(Text=text, Separators=",")  # -> simplify(Result)
list_item = ListItem(List=text_split, Index=0, Wrap=True)  # -> Item, Item1

# ---- group: Lag nye plan langs ledelinjen med normal fra tangenter i xy-plan.
divide_curve = DivideCurve(Curve=curve, Count=Slider(95, range=0..100), Kinks=False)  # -> Points, Tangents, Parameters
c_script = CSharpScript(tangent=divide_curve.Tangents)  # -> rettTangent, CrossProdZ; inputs tangent: Vector3d
# ---------- c_script: C# ----------
    Vector3d zVec = Vector3d.ZAxis; // Create a global Z-vector {0,0,1}

    Vector3d cp = Vector3d.CrossProduct(tangent, Vector3d.ZAxis); // Finner kryss-produkt mellom tangent og global z-vector
    Vector3d rt = new Vector3d(tangent.X, tangent.Y, 0); // projiserer tangent til xy-plan


    // output
    rettTangent = rt;
    CrossProdZ = cp;
# ---------- end c_script ----------
plane_normal = PlaneNormal(Origin=divide_curve.Points, ZAxis=c_script.rettTangent)

# ---- group: Forleng kurve med 1% av opprinnelig lengde
curve_5 = Curve(entwine)
length = Length(Curve=curve_5)
multiplication = Multiplication(A=length, B="0.05")
extend_curve = ExtendCurve(Curve=curve_5, Type=0, Start=multiplication, End=multiplication)

# ----
c_script_2 = CSharpScript(tangent=divide_curve.Tangents)  # -> rettTangent, CrossProdZ; inputs tangent: Vector3d; same code as c_script
brep = Brep(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)
line = Line(StartPoint="{0,-5,0}", EndPoint="{-2-5,-13,0}")
line_2 = Line(StartPoint="{-2-5,-13,0}", EndPoint="{0,-5,0}")
panel = Panel("2")

# ---- group: Hent ut forskyvninger vertikalt og horisontalt. / z-forskyvning
number = Number(list_item.Item1)

# ----
length_2 = Length(Curve=curve_3)

# ---- group: Hent ut forskyvninger vertikalt og horisontalt. / x-forskyvning
number_2 = Number(list_item.Item)

# ----
merge = Merge(Data1=line_2, Data2=line)
# TODO: The orienting in the C# script does not account for the offset of the line from the plane center.
c_script_3 = CSharpScript(crv=curve_2, div=Slider(25, range=0..100), lCrv=curve_3, rCrv=curve_4, sectionCurve=merge)  # -> out, A, B, C; inputs crv: Curve, div: Int32, lCrv: Curve, rCrv: Curve, sectionCurve: list of Curve
# ---------- c_script_3: C# usings ----------
using Rhino.Geometry.Intersect;
using System.Linq;
# ---------- c_script_3: C# ----------
    List<Plane> result = new List<Plane>();

    var tList = crv.DivideByCount(div, true);
    var planes = crv.GetPerpendicularFrames(tList);
    Vector3d[] xyTangents = planes.Select(p => (new Vector3d(p.Normal.X, p.Normal.Y, 0))).ToArray(); // Remove the global Z part of the tangents
    foreach (Vector3d tangent in xyTangents)
    {
      bool flip = tangent.Unitize(); // Unitize all the vectors.
    }
    Vector3d[] crossProduct = planes.Select(p => Vector3d.CrossProduct(p.Normal, Vector3d.ZAxis)).ToArray();

    Plane[] testPlanes = planes.Zip(crossProduct, (plane, x) => new Plane(plane.Origin, x, Vector3d.ZAxis))
      .ToArray();

    var guidePlanes = planes.Zip(xyTangents, (plane, vector) => new Plane(plane.Origin, vector)).ToArray();
    // extend the curves
    lCrv = lCrv.Extend(CurveEnd.Both, lCrv.GetLength() * 0.02, CurveExtensionStyle.Smooth);
    rCrv = rCrv.Extend(CurveEnd.Both, rCrv.GetLength() * 0.02, CurveExtensionStyle.Smooth);

    // intersect planes and curves
    List<Plane> leftPlanes = IntersectionPlanes(lCrv, testPlanes);
    List<Plane> rightPlanes = IntersectionPlanes(rCrv, testPlanes);
    // move curves to reference planes
    // -- 4 move the section curves along the guides.
    List<Curve> leftSections = ReorientedSectionCurves(Plane.WorldXY, leftPlanes, sectionCurve[0]); // the third item in the list should be the second curve
    List<Curve> rightSections = ReorientedSectionCurves(Plane.WorldXY, rightPlanes, sectionCurve[1]); // the fourth item is right curve
    //List<Curve> middleTopSections = ReorientedSectionCurves(sectionPlane, guidePlanes.ToList(), sections[0]); // the first item is top middle curve
    //List<Curve> middleBottomSections = ReorientedSectionCurves(sectionPlane, guidePlanes.ToList(), sections[1]); // the second item is bottom middle curve

    // -- 5 Connect the curves at each section. 

    // create a nested list of the curves sorted clockwise
    List<List<Curve>> nestedSectionCurves = new List<List<Curve>>() {leftSections, rightSections};
    var organisedSections = FlipNested2DList(nestedSectionCurves);
    // For concvenience, we flip the nested list to have all four curves on one plane in the same subList
     var planeSectionCurves = CreatePlaneSections(organisedSections);

    // -- 6 Loft an Cap the curves
    Brep loftedBrep = Brep.CreateFromLoft(planeSectionCurves, Point3d.Unset,
      Point3d.Unset, LoftType.Normal, false)[0].CapPlanarHoles(0.001);
    A = leftSections;
    B = rightSections;
    C = loftedBrep;
# ---------- c_script_3: C# additional code ----------
  
  public List<Curve> CreatePlaneSections(Curve[,] nestedSections)
  {

    List<Curve> planeSections = new List<Curve>();
    int rows = nestedSections.GetLength(0);
    int cols = nestedSections.GetLength(1);

    for (int i = 0; i < rows; i++) // iterate through each plane
    {
      List<Curve> crvs = new List<Curve>(); // initiate new list of control points for polycurve
      for (int j = 0; j < cols; j++)
      {
        crvs.Add(nestedSections[i, j]); // add the current curve
        List<Point3d> endPts;
        if (j != (cols - 1))
        {                   
          endPts = new List<Point3d>() { nestedSections[i, j].PointAtEnd,
              nestedSections[i, j + 1].PointAtStart };
        }
        else // at the final iteration we add the first point instead
        {
          endPts = new List<Point3d>() { nestedSections[i, j].PointAtEnd,
              nestedSections[i, 0].PointAtStart };
                        
        }
        Curve connectingCurve = Curve.CreateControlPointCurve(endPts, 1);
        crvs.Add(connectingCurve);
      }

      // join all the curves
      Curve planeSection = Curve.JoinCurves(crvs)[0];
      planeSections.Add(planeSection);
    }

    return planeSections;
  }
  public Curve[,] FlipNested2DList(List<List<Curve>> nestedList)
  {
    // before we start, we want to ensure that each list has the same lenght
    List<int> subLengths = nestedList.Select(lst => lst.Count).ToList();// List of lengths for each sublist
    // in the below line we ensure that all sublist have the same length and return true if that is the case
    bool testLength = (subLengths.Where(el => el == nestedList[0].Count).Count() == nestedList.Count) ? true : false;
    if (!testLength)
    {
      Print("Something not working");
    }

    int rows = nestedList.Count;
    int cols = nestedList[0].Count;
    Curve[,] result = new Curve[cols, rows]; // instantiate an empty array
    for (int i = 0; i < rows; i++)
    {
      for (int j = 0; j < cols; j++)
      {
        result[j, i] = nestedList[i][j];
      }
    }
    return result;

  }
  
  public List<Curve> ReorientedSectionCurves(Plane refPlane, List<Plane> newPlanes, Curve sectionCurve)
  {
    List<Curve> orientedCurves = new List<Curve>(); // initiate empty list for the oriented curves

    for (int i = 0; i < newPlanes.Count; i++)
    {
      
      Plane toPlane = newPlanes[i]; // the plane we want to move to. 
      
      var trans = Transform.PlaneToPlane(refPlane, toPlane);

      orientedCurves.Add(sectionCurve.DuplicateCurve());
      orientedCurves[i].Transform(trans);
    }
    
    return orientedCurves;

  }

  public List<Plane> IntersectionPlanes(Curve crv, Plane[] pArray)
  {
    List<Plane> interPlanes = new List<Plane>();

    foreach (var p in pArray)
    {
      CurveIntersections intersection = Intersection.CurvePlane(crv, p, 0.001);
      if (intersection[0].IsPoint)
      {
        Point3d pt = intersection[0].PointA;
        Plane movedPlane = new Plane(pt, p.XAxis, p.YAxis);
        interPlanes.Add(movedPlane);
      }
    }


    return interPlanes;
  }
# ---------- end c_script_3 ----------
panel_2 = Panel(length_2)

# ---- group: Flytt punkter på ledekurver. / CrossProdZ
vector = Vector(c_script.CrossProdZ)

# ---- group: Flytt punkter på ledekurver.
curve_plane = CurvePlane(Curve=extend_curve, Plane=plane_normal)  # -> simplify(Points), ParamsC, ParamsP
amplitude = Amplitude(CrossProdZ=vector, Amplitude=number_2)
unit_z = UnitZ(Factor=number)
trim_tree = TrimTree(Tree=curve_plane.Points, Depth=1)
match_tree = MatchTree(Tree=amplitude, Guide=number_2)
addition = Addition(A=match_tree, B=unit_z)
c_script_4 = CSharpScript(pts=trim_tree, vecs=addition)  # -> out, A; inputs pts: tree of Point3d, vecs: tree of Vector3d
# ---------- c_script_4: C# ----------
    
    DataTree<Point3d> finalTree = new DataTree<Point3d>(); // initiate empty tree
    
    foreach (GH_Path path in vecs.Paths)
    {
      var inds = path.Indices; // Path for the vectors
      List<Vector3d> branchVecs = vecs.Branch(path);
      List<Point3d> branchPts = pts.Branch(inds[0]);
      
      List<Point3d> movedPts = new List<Point3d>(); // initiate empty list for moved points
      // Iterate through the two branches
      for (int i = 0; i < branchVecs.Count; i++)
      {
        movedPts.Add( Point3d.Add( branchPts[i], branchVecs[i] ) );
      }
      // add the moved points list to the tree
      finalTree.AddRange(movedPts, path);
      
    }
    A = finalTree;
# ---------- end c_script_4 ----------
path_mapper = PathMapper(c_script_4.A, source="{A;B}(i)", target="{A;i}")

# ----
panel_3 = Panel(c_script_3.out)

# ---- group: Sorter punkter i riktig rekkefølge
split_tree = SplitTree(Data=path_mapper, Masks=flatten("{0;*}"))  # -> Positive, Negative
split_tree_2 = SplitTree(Data=split_tree.Negative, Masks=flatten("{1;*}"))  # -> Positive, Negative
match_tree_2 = MatchTree(Tree=split_tree_2.Positive, Guide=split_tree.Positive)
match_tree_3 = MatchTree(Tree=split_tree_2.Negative, Guide=split_tree.Positive)
split_list = SplitList(List=split_tree.Positive, Index="1")  # -> ListA, ListB
match_tree_4 = MatchTree(Tree=split_list.ListB, Guide=split_tree.Positive)
match_tree_5 = MatchTree(Tree=split_list.ListA, Guide=split_tree.Positive)
merge_2 = Merge(Data1=match_tree_5, Data2=match_tree_3, Data3=match_tree_4, Data4=match_tree_2, Data5=match_tree_5)  # -> simplify(Result)
polyline = PolyLine(Vertices=merge_2, Closed=invert(False))

# ---- group: Sorter punkter i riktig rekkefølge / Generer Brep
loft = Loft(
    Curves=flatten(polyline),
    Options={Adjust=False, Closed=False, LoftEnds=0, LoftSimp=0, LoftType=0, Rebuild=10, Refit=0.01})
cap_holes = CapHoles(Brep=loft)

# ----
brep_2 = Brep(cap_holes)

# ---- group: Topp av dekke
deconstruct_brep = DeconstructBrep(Brep=brep_2)  # -> Faces, Edges, Vertices
area = Area(Geometry=deconstruct_brep.Faces)  # -> Area, Centroid
sort_list = SortList(Keys=deconstruct_brep.Faces, ValuesValuesA=deconstruct_brep.Faces)  # -> Keys, reverse(ValuesValuesA)
panel_4 = Panel("""0
1""")
list_item_2 = ListItem(List=sort_list.ValuesValuesA, Index=panel_4, Wrap=True)
brep_join = BrepJoin(Breps=list_item_2)  # -> Breps, Closed
