# Grasshopper definition dag1_del2_bruplate.gh (Grasshopper 1.0.7)
# plug-ins: HAL for Grasshopper

sessionsettings = SessionSettings()  # -> Data, DefaultSettings
geometry_pipeline = GeometryPipeline(
    GroupByLayer=False,
    GroupByType=False,
    IncludeHidden=True,
    IncludeLocked=True,
    LayerFilter="Ledelinjer::Venstre kant",
    NameFilter="*",
    SublayerFiltering=True,
    TypeFilter=4)
geometry_pipeline_2 = GeometryPipeline(
    GroupByLayer=False,
    GroupByType=False,
    IncludeHidden=True,
    IncludeLocked=True,
    LayerFilter="Ledelinjer::Høyre kant",
    NameFilter="*",
    SublayerFiltering=True,
    TypeFilter=4)
geometry_pipeline_3 = GeometryPipeline(
    GroupByLayer=False,
    GroupByType=False,
    IncludeHidden=True,
    IncludeLocked=True,
    LayerFilter="Ledelinjer::Senterlinje",
    NameFilter="*",
    SublayerFiltering=True,
    TypeFilter=4)
geometry_pipeline_4 = GeometryPipeline(
    GroupByLayer=False,
    GroupByType=False,
    IncludeHidden=True,
    IncludeLocked=True,
    LayerFilter="Tverrsnitt::*",
    NameFilter="*",
    SublayerFiltering=True,
    TypeFilter=4)
list_item = ListItem(List=geometry_pipeline_4, Index=0, Wrap=True)  # -> Item, Item1, Item2, Item3
antall_plan = Slider(21, range=10..100)

# ---- group: Senterlinje
curve = Curve(geometry_pipeline_3)

# ----
integer = Integer(antall_plan)
perp_frames = PerpFrames(Curve=curve, Count=expr("x-1", integer), Align=True)  # -> Frames, Parameters
deconstruct_plane = DeconstructPlane(Plane=perp_frames.Frames)  # -> Origin, XAxis, YAxis, ZAxis

# ---- group: Nye plan
unit_z = UnitZ(Factor=1)
vector = Vector(deconstruct_plane.ZAxis)
point = Point(deconstruct_plane.Origin)
cross_product = CrossProduct(VectorA=vector, VectorB=unit_z, Unitize=Toggle(True))  # -> Vector, Length
construct_plane = ConstructPlane(Origin=point, XAxis=cross_product.Vector, YAxis=unit_z)
plane = Plane(construct_plane)

# ---- group: Nye plan / Tangent i xy-plan
deconstruct_vector = DeconstructVector(Tangent=vector)  # -> XComponent, YComponent, ZComponent
vector_xyz = VectorXYZ(XComponent=deconstruct_vector.XComponent, YComponent=deconstruct_vector.YComponent, ZComponent=0)  # -> XyTangent, Length
unit_vector = UnitVector(Vector=vector_xyz.XyTangent)

# ----
vector_2 = Vector(plane)

# ---- group: Flytt tverrsnitt til lokale plan langs kurver / Høyre tverrsnitt
curve_2 = Curve([list_item.Item1, list_item.Item])

# ---- group: Flytt tverrsnitt til lokale plan langs kurver
curve_3 = Curve(geometry_pipeline_3)
plane_2 = Plane(plane)
curve_plane = CurvePlane(Curve=curve_3, Plane=plane_2)  # -> Points, ParamsC, ParamsP
plane_origin = PlaneOrigin(Base=plane_2, Origin=flatten(curve_plane.Points))
xy_plane = XYPlane(Origin=Point(0, 0, 0))
orient = Orient(Geometry=graft(curve_2), Source=xy_plane, Target=plane_origin)  # -> Geometry, Transform
curve_4 = Curve(orient.Geometry)

# ---- group: Flytt tverrsnitt til lokale plan langs kurver / Høyre tverrsnitt
curve_5 = Curve(list_item.Item2)

# ---- group: Flytt tverrsnitt til lokale plan langs kurver
curve_6 = Curve(geometry_pipeline_2)
plane_3 = Plane(plane)
curve_plane_2 = CurvePlane(Curve=curve_6, Plane=plane_3)  # -> Points, ParamsC, ParamsP
plane_origin_2 = PlaneOrigin(Base=plane_3, Origin=flatten(curve_plane_2.Points))
xy_plane_2 = XYPlane(Origin=Point(0, 0, 0))
orient_2 = Orient(Geometry=curve_5, Source=xy_plane_2, Target=plane_origin_2)  # -> Geometry, Transform
curve_7 = Curve(orient_2.Geometry)

# ---- group: Flytt tverrsnitt til lokale plan langs kurver / Høyre tverrsnitt
curve_8 = Curve(list_item.Item3)

# ---- group: Flytt tverrsnitt til lokale plan langs kurver
curve_9 = Curve(geometry_pipeline)
plane_4 = Plane(plane)
curve_plane_3 = CurvePlane(Curve=curve_9, Plane=plane_4)  # -> Points, ParamsC, ParamsP
plane_origin_3 = PlaneOrigin(Base=plane_4, Origin=flatten(curve_plane_3.Points))
xy_plane_3 = XYPlane(Origin=Point(0, 0, 0))
orient_3 = Orient(Geometry=curve_8, Source=xy_plane_3, Target=plane_origin_3)  # -> Geometry, Transform
curve_10 = Curve(orient_3.Geometry)

# ----
explode_tree = ExplodeTree(Data=simplify(curve_4))  # -> Branch0, Branch1

# ---- group: Høyre
curve_11 = Curve(curve_7)

# ---- group: Venstre
curve_12 = Curve(curve_10)

# ---- group: Topp
curve_13 = Curve(explode_tree.Branch0)

# ---- group: Bunn
curve_14 = Curve(explode_tree.Branch1)

# ----
end_points = EndPoints(Curve=curve_11)  # -> Start, End
end_points_2 = EndPoints(Curve=curve_12)  # -> Start, End
end_points_3 = EndPoints(Curve=curve_13)  # -> Start, End
end_points_4 = EndPoints(Curve=curve_14)  # -> Start, End
line = Line(StartPoint=end_points_2.Start, EndPoint=end_points_3.Start)  # -> graft(Line)
line_2 = Line(StartPoint=end_points.Start, EndPoint=end_points_3.End)  # -> graft(Line)
line_3 = Line(StartPoint=end_points.End, EndPoint=end_points_4.End)  # -> graft(Line)
line_4 = Line(StartPoint=end_points_2.End, EndPoint=end_points_4.Start)  # -> graft(Line)
merge = Merge(
    Data1=simplify(line),
    Data2=simplify(line_2),
    Data3=simplify(line_3),
    Data4=simplify(line_4),
    Data5=simplify(graft(curve_11)),
    Data6=simplify(graft(curve_13)),
    Data7=simplify(graft(curve_12)),
    Data8=simplify(graft(curve_14)))  # -> simplify(Result)

join_curves = JoinCurves(Curves=merge, Preserve=False)  # -> flatten(Curves)
loft = Loft(Curves=join_curves, Options={Adjust=False, Closed=False, LoftEnds=0, LoftSimp=0, LoftType=0, Rebuild=10, Refit=0.01})
cap_holes_ex = CapHolesEx(Brep=loft)  # -> Brep, Caps, Solid
