# Grasshopper definition spennarmering fra senterlinjer.gh (Grasshopper 1.0.7)
# plug-ins: HAL for Grasshopper

sessionsettings = SessionSettings()  # -> Data, DefaultSettings
brep = Brep(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)
panel = Panel("""0
-8
-11
-14""")

# ---- group: Armeringskoordinater
text = Text(["0 -0.7", "0.5 -0.7571", "1 -0.8118", "1.5 -0.8641", "2 -0.9139", "2.5 -0.9613", "3 -1.0062", "3.5 -1.0488", "4 -1.0889", "4.5 -1.1266"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])

# ---- group: Top of bridge deck
brep_2 = Brep(brep)

# ---- group: Senterlinje
curve = Curve(reparameterize(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))

# ---- group: Radius kabelkanal
number = Number(0.1)

# ----
panel_2 = Panel(",")
text_split = TextSplit(Text=text, Separators=" ")
list_item = ListItem(List=text_split, Index=0, Wrap=True)  # -> Item, Item1
construct_point = ConstructPoint(XCoordinate=list_item.Item, YCoordinate=list_item.Item1, ZCoordinate=0)

sort_list = SortList(Keys=flatten(list_item.Item))  # -> Keys, ValuesValuesA
project = Project(Geometry=curve, Plane=PlaneXY(0, 0, 0))  # -> Geometry, Transform
length = Length(Curve=project.Geometry)
list_item_2 = ListItem(List=sort_list.Keys, Index="-1", Wrap=True)
expression = Expression(l1=list_item_2, l2=length, Expression="(l1-l2)/2")
extend_curve = ExtendCurve(Curve=project.Geometry, Type=0, Start=expression, End=expression)  # -> reparameterize(Curve)

flatten_tree = FlattenTree(Tree=list_item.Item1, Path="{0}")
cull_duplicates = CullDuplicates(Points=flatten(construct_point), Tolerance=0.1, CullMode=3)  # -> Points, Indices, Valence
deconstruct = Deconstruct(Point=cull_duplicates.Points)  # -> XComponent, YComponent, ZComponent
quick_graph = QuickGraph(flatten_tree, SortOrder=0)
division = Division(A=deconstruct.XComponent, B=list_item_2)
evaluate_curve = EvaluateCurve(Curve=reparameterize(extend_curve), Parameter=division)  # -> Point, Tangent, Angle
c_script = CSharpScript(tangent=evaluate_curve.Tangent)  # -> rettTangent, CrossProdZ; inputs tangent: Vector3d
# ---------- c_script: C# ----------
    Vector3d zVec = Vector3d.ZAxis; // Create a global Z-vector {0,0,1}

    Vector3d cp = Vector3d.CrossProduct(tangent, Vector3d.ZAxis); // Finner kryss-produkt mellom tangent og global z-vector
    Vector3d rt = new Vector3d(tangent.X, tangent.Y, 0); // projiserer tangent til xy-plan


    // output
    rettTangent = rt;
    CrossProdZ = cp;
# ---------- end c_script ----------
plane_normal = PlaneNormal(Origin=evaluate_curve.Point, ZAxis=c_script.rettTangent)
deconstruct_plane = DeconstructPlane(Plane=plane_normal)  # -> Origin, XAxis, YAxis, ZAxis
amplitude = Amplitude(Vector=deconstruct_plane.XAxis, Amplitude=graft(panel))
move = Move(Geometry=deconstruct_plane.Origin, Motion=amplitude)  # -> Geometry, Transform
unit_z = UnitZ(Factor=1)
project_point = ProjectPoint(Point=move.Geometry, Direction=unit_z, Geometry=brep_2)  # -> Point, Index
unit_z_2 = UnitZ(Factor=deconstruct.YComponent)
move_2 = Move(Geometry=project_point.Point, Motion=unit_z_2)  # -> Geometry, Transform
interpolate = Interpolate(Vertices=move_2.Geometry, Degree=3, Periodic=False, KnotStyle=1)  # -> Curve, Length, Domain
evaluate_curve_2 = EvaluateCurve(Curve=reparameterize(interpolate.Curve), Parameter=division)  # -> Point, Tangent, Angle
circle_cnr = CircleCNR(Center=evaluate_curve_2.Point, Normal=evaluate_curve_2.Tangent, Radius=number)
clean_tree = CleanTree(RemoveNulls=True, RemoveInvalid=True, RemoveEmpty=False, Tree=circle_cnr)
loft_options = LoftOptions(Closed=False, Adjust=invert(False), Rebuild=0, Refit=0, Type=0)
loft = Loft(Curves=clean_tree, Options=loft_options)
cap_holes_ex = CapHolesEx(Brep=loft)  # -> Brep, Caps, Solid
brep_3 = Brep(cap_holes_ex.Brep)
