# Grasshopper definition test_debug_dag3.gh (Grasshopper 1.0.7)
# plug-ins: HAL for Grasshopper

sessionsettings = SessionSettings()  # -> Data, DefaultSettings
curve = Curve(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)
c_script = CSharpScript(crv1=curve, div1="50")  # -> out, A; inputs crv1: Curve, div1: Int32
# ---------- c_script: C# ----------
    List<Plane> planes = GetSectionPlanesFromCurves(crv1, div1);
    A = planes;
# ---------- c_script: C# additional code ----------
  List<Plane> GetSectionPlanesFromCurves(Curve crv, int div)
  {
    // divide curve 
    Point3d[] divPts; // division points on curve
    double[] parameterList = crv.DivideByCount(div, true, out divPts);


    List<Plane> sectionPlanes = new List<Plane>();

    for (int i = 0; i < divPts.Length; i++)
    {
      // get tangents
      Vector3d tangent = crv.TangentAt(parameterList[i]); // fix

      Point3d localOrigin = divPts[i]; // fix
      Vector3d localX = Vector3d.CrossProduct(tangent, Vector3d.ZAxis);
      Vector3d localY = Vector3d.ZAxis;
      // create new plane
      Plane localSectionPlane = new Plane(localOrigin, localX, localY);

      sectionPlanes.Add(localSectionPlane); // add to list
    }        
                        
                       
    return sectionPlanes;
  }
# ---------- end c_script ----------
